vi "student_moose.gvi"   [LabVIEW NXG]
inputs:
  "Modulation Parameters": T6 = {"Modulation Type"="QPSK", "Control Information\nfor Packet Header/Tail"={"Training Sequence (derived)"=[], "Zero Pad Length"=0}, "RX Oversample Factor"=20, "Synchronization Options"={"Synchronization Method"="Timing Estimation", "Fixed Offset"=0, "Symbol Timing Recovery Method"="Max Energy", "Frame Detection Method"="Sliding Correlator", "Correct Frequency Offset"=FALSE}, "Number of Data Symbols (Derived)"=100, "RX Sample Rate"=4000000, "Pulse Shaping Parameters"={"Modulation Type"="PSK", "Pulse Shaping Filter"="Root Raised Cos", "Filter Parameter"=0.5, "Filter Length (Symbols)"=8}, "Channel Estimation/Equalization Parameters"={"Equalization Method"="Direct", "Channel Estimate Length"=1, "Equalizer Length"=1, "Equalizer Delay"=-1}}
  "Input": c128[]
  "Error In": error
outputs:
  "Error Out": error
  "Output": c128[]
  "Frequency Offset": f64
types:
  T1 = cluster{"Training Sequence (derived)": c128[], "Zero Pad Length": i32}
  T2 = cluster{"Synchronization Method": string, "Fixed Offset": i32, "Symbol Timing Recovery Method": string, "Frame Detection Method": string, "Correct Frequency Offset": bool}
  T3 = enum{"none", "Raised Cosine", "Root Raised Cos", "Gaussian"}
  T4 = cluster{"Modulation Type": enum{"FSK", "PSK", "QAM", "MSK", "PAM", "ASK"}, "Pulse Shaping Filter": T3, "Filter Parameter": f64, "Filter Length (Symbols)": i32}
  T5 = cluster{"Equalization Method": string, "Channel Estimate Length": i32, "Equalizer Length": i32, "Equalizer Delay": i32}
  T6 = cluster{"Modulation Type": string, "Control Information\nfor Packet Header/Tail": T1, "RX Oversample Factor": i32, "Synchronization Options": T2, "Number of Data Symbols (Derived)": i32, "RX Sample Rate": f64, "Pulse Shaping Parameters": T4, "Channel Estimation/Equalization Parameters": T5}
diagram:
  Property Node(instance in=$"Modulation Parameters") -> ("RX Sample Rate"=w1, "Channel Estimation/Equalization Parameters:Channel Estimate Length"=w2, "Control Information\nfor Packet Header/Tail:Training Sequence (derived)"=w3)
  Decrement(x=w2) -> w4
  Array Size(array=w3) -> (size(s)=w5)
  Complex Conjugate(x + iy=$Input) -> w6
  for (N = w5) (iteration -> i1) {
    Add(w4, i1) -> w8
    Array Index(array=w6) -> (out0[w8]=w9)
    Add(w5, w8) -> w10
    Array Index(array=$Input) -> (out0[w10]=w11)
    Multiply(w9, w11) -> w12
    append w12 to w7
  }
  Add Array Elements(numeric array=w7) -> (sum=w13)
  Complex To Polar(r * e^(i*theta)=w13) -> (theta=w14)
  Multiply(PiTimes2, w5) -> w15
  Divide(x=w14, y=w15) -> w16
  Reciprocal(x=w1) -> w17
  Divide(x=w16, y=w17) -> w18
  $"Frequency Offset" <- w18
  Array Size(array=$Input) -> (size(s)=w19)
  for (N = w19) (iteration -> i2) {
    w20 = each element of $Input
    Multiply(w16, 0-1i, PiTimes2, i2) -> w22
    Exponential(x=w22) -> w23
    Multiply(w20, w23) -> w24
    append w24 to w21
  }
  $Output <- w21
  $"Error Out" <- $"Error In"
